# Dynamo graph test_proj_1.dyn (Dynamo 2.12.0.5650)
# packages: dyn_proj_library 1.0.0

# group: Getting EPSG code for cs using filter-criteria
projected_russian_crs_list = dyn_proj_library.ProjDB_resources.projected_russian_crs_list()
code_block = CodeBlock { "1964"; }
contains = String.Contains(string=projected_russian_crs_list.CS_names, searchFor=code_block)
filterByBoolMask = List.FilterByBoolMask(list=projected_russian_crs_list.CS_names, mask=contains)
indexOf = List.IndexOf(list=projected_russian_crs_list.CS_names, element=filterByBoolMask.in)
getItemAtIndex = List.GetItemAtIndex(list=projected_russian_crs_list.EPSG_codes, index=indexOf)
code_block_2 = CodeBlock(a=getItemAtIndex) { a[0]; }

code_block_3 = CodeBlock { 4326; 0.0; }

# group: Example of data to reproject
file_path = Filename("..\examples\points_1964_1.csv")
importCSV = Data.ImportCSV(filePath=file_path)
code_block_4 = CodeBlock(a=importCSV) { a[0]; a[1]; }

reprojecting = dyn_proj_library.Reprojecting.Reprojecting(cs_source_code=code_block_2, cs_target_code=code_block_3.out0, coord_x=code_block_4.out0, coord_y=code_block_4.out1, coord_z=code_block_3.out1)
XYZ = dyn_proj_library.Reprojecting.XYZ(reprojecting=reprojecting)
dynamoPoint = dyn_proj_library.Reprojecting.DynamoPoint(reprojecting=reprojecting)
